vi "HomingSampleRotor.gvi"   [LabVIEW NXG 5.0.0]
inputs:
  "session in": "VISA Instr"
  "error in": error
outputs:
  "session out": "VISA Instr"
  "error out": error
uses:
  NI::VISA::Open (Instr).gvi
  NI::VISA::Write (Instr, String).gvi
  NI::VISA::Read (Instr, String).gvi
diagram:
  case ($"error in") {
    frame Error, Default {
      w1 = $"session in"
      w2 = $"error in"
    }
    frame No Error {
      call "Open (Instr).gvi"(resource name=$"session in", error in=$"error in") -> (session out=w3, error out=w4)
      call "Write (Instr, String).gvi"(session in=w3, error in=w4, write buffer="0gs") -> (session out=w5, error out=w6)
      call "Read (Instr, String).gvi"(session in=w5, error in=w6, byte count=5) -> (session out=w7, error out=w8)
      call "Write (Instr, String).gvi"(session in=w7, error in=w8, write buffer="0so000064CA") -> (session out=w9, error out=w10)
      call "Write (Instr, String).gvi"(session in=w9, error in=w10, write buffer="0ho0") -> (session out=w1, error out=w2)
    }
  }
  $"session out" <- w1
  $"error out" <- w2
