vi "Rotary Stage Approach to Gcode.gvi"   [LabVIEW NXG 5.0.0]
inputs:
  "Error In": error
  "Misc Data Mega Cluster In": "Misc Data Mega Cluster.gtype"
  "Approach Operation": "XZ Approach Operation.gtype" = "Retract"
  "Cell Label": string
outputs:
  "Error Out": error
  "Gcode Instruction": string
types:
  "Full Reference Cluster.gtype" = cluster{"Enum Reference Cluster": "Enum Control Reference Cluster.gtype", "Boolean Reference Cluster": "Boolean Control Reference Cluster.gtype", "Numeric Reference Cluster": "Numeric Control Reference Cluster.gtype", "Numeric Cluster Reference Cluster": "Numeric Cluster Reference Cluster.gtype", "Path Reference Cluster": "Path Reference Cluster.gtype", "Cluster Reference Cluster": "Cluster Reference Cluster.gtype", "XZ Stage Controls Reference Cluster": "XZ Stage Controls Reference Cluster.gtype"}
  "Cell Naming Cluster.gtype" = cluster{"Cell Label": string, "Sample Prefix": string, "Author Initials": string, "Current Date": string, "Batch Name": string}
  T1 = cluster{"X Coordinate (mm)": f64, "Z Coordinate (mm)": f64, "Aprch Distance (mm)": f64}
  T2 = cluster{"X Coordinate (mm)": f64, "Z Coordinate (mm)": f64, "Vertical Spacing (mm)": f64, "Aprch Distance (mm)": f64, "Aprch Dstnc L.12 (mm)": f64}
  "XZ All Position Cluster.gtype" = cluster{"Diffusor Coordinates": T1, "Photodetector Coordinates": T1, "Cell R.01 Coordinates": T2}
  T3 = cluster{"Thorlabs Motor Serial Number File Path": path, "Default Data Saving Location": path}
  "Misc Data Mega Cluster.gtype" = cluster{"Full Reference Cluster": "Full Reference Cluster.gtype", "Cell Naming Cluster": "Cell Naming Cluster.gtype", "All XZ Position Cluster": "XZ All Position Cluster.gtype", "All Paths": T3}
  "XZ Approach Operation.gtype" = enum{"Retract", "Approach Cell", "Approach Photodetector", "Approach Diffusor"}
uses:
  Rainbow Measurement Setup::Side Functions::Instrument Control::Arduino::XZ Stage Arduino::XZ Stage Label to Coordinates.gvi
diagram:
  # This SubVI takes an input operation to decide if to approach or to retract and then it converts it into the Y
  # correcponding Gcode.
  case ($"Error In") {
    frame Error, Default {
      w1 = $"Error In"
      w2 = ""
    }
    frame No Error {
      case ($"Approach Operation") {
        frame "Retract", Default {
          w3 = 0
          w4 = $"Error In"
        }
        frame "Approach Cell" {
          call "XZ Stage Label to Coordinates.gvi"(Cell Label=$"Cell Label", Misc Data Mega Cluster In=$"Misc Data Mega Cluster In", Error In=$"Error In") -> (Y coordinate out=w3, Error Out=w4)
        }
        frame "Approach Photodetector" {
          Property Node(instance in=$"Misc Data Mega Cluster In") -> ("All XZ Position Cluster:Photodetector Coordinates:Aprch Distance (mm)"=w3)
          w4 = $"Error In"
        }
        frame "Approach Diffusor" {
          Property Node(instance in=$"Misc Data Mega Cluster In") -> ("All XZ Position Cluster:Diffusor Coordinates:Aprch Distance (mm)"=w3)
          w4 = $"Error In"
        }
      }
      Number To Fractional String(number=w3, precision (6)=1, use system decimal point (T)=FALSE) -> (F-format string=w5)
      Search And Replace String(error in (no error)=w4, input string=w5, replace string ("")=".", search string=",") -> (error out=w1, result string=w6)
      Concatenate Strings("G1 Y", w6) -> w2
    }
  }
  $"Gcode Instruction" <- w2
  $"Error Out" <- w1
