vi "Rotary Stage Coordinate to Gcode.gvi"   [LabVIEW NXG 5.0.0]
inputs:
  "Error In": error
  "Rotary Move Cluster": "Rotary Move Cluster.gtype"
outputs:
  "Error Out": error
  "Gcode Instruction": string
types:
  "Rotary Move Cluster.gtype" = cluster{"Position Degrees": f64, "Feedrate": i32}
diagram:
  # This SubVI converts an Rotary Coordinate cluster into the command needed to
  # move to the required coordinate and it stores the gcode as the third element
  # of the Rotary Coordinates cluster.
  case ($"Error In") {
    frame Error, Default {
      w1 = $"Error In"
      w2 = ""
    }
    frame No Error {
      Property Node(instance in=$"Rotary Move Cluster") -> ("Position Degrees"=w3, "Feedrate"=w4)
      Number To Fractional String(number=w3, precision (6)=2, use system decimal point (T)=FALSE) -> (F-format string=w5)
      Search And Replace String(error in (no error)=$"Error In", input string=w5, replace string ("")=".", search string=",") -> (error out=w1, result string=w6)
      Number To Fractional String(number=w4, precision (6)=0, use system decimal point (T)=FALSE) -> (F-format string=w7)
      Search And Replace String(input string=w7, replace string ("")=".", search string=",") -> (result string=w8)
      Concatenate Strings("G1 R", w6, " F", w8) -> w2
    }
  }
  $"Error Out" <- w1
  $"Gcode Instruction" <- w2
