vi "Rotary Stage Fast Movement.gvi"   [LabVIEW NXG 5.0.0]
inputs:
  "Error In": error
  "XZ Carriage Arduino open Visa session In": "VISA Instr"
  "XZ Stage Arduino Log In": string
  "Input Command": string = "G1 X100 Z100"
  "ms Wait Fast Movement": u32 = 200
outputs:
  "Error Out": error
  "XZ Carriage Arduino open Visa Session Out": "VISA Instr"
  "XZ Stage Arduino Log Out": string
panel controls:
  "Abort": bool
panel indicators:
  "XZ Stage Arduino Log While": string
uses:
  NI::VISA::Write (Instr, String).gvi
  Rainbow Measurement Setup::Side Functions::Utilities::Time Related Operations::Wait ms.gvi
  NI::VISA::Read (Instr, String).gvi
  NI::VISA::Clear (Instr).gvi
diagram:
  case ($"Error In") {
    frame Error, Default {
      w1 = $"Error In"
      w2 = $"XZ Carriage Arduino open Visa session In"
      w3 = $"XZ Stage Arduino Log In"
    }
    frame No Error {
      Concatenate Strings($"Input Command", "\r\n") -> w4
      call "Write (Instr, String).gvi"(session in=$"XZ Carriage Arduino open Visa session In", error in=$"Error In", write buffer=w4) -> (session out=w5, error out=w6)
      call "Wait ms.gvi"(Error In=w6, Milliseconds to Wait=$"ms Wait Fast Movement") -> (Error Out=w7)
      s1 = $"XZ Stage Arduino Log In"  # shift register
      while (iteration -> i1) {
        Wait Until Next Multiple(multiple to wait=10)
        Property Node(instance in=w5, error in=w7) -> ("ASRL Bytes at Port"=w8, error out=w9, instance out=w10)
        Is Not Equal To 0(x=w8) -> w11
        case (w11) {
          frame False, Default {
            w12 = ""
            w2 = w10
            w13 = w9
          }
          frame True {
            call "Read (Instr, String).gvi"(session in=w10, error in=w9, byte count=w8) -> (session out=w14, error out=w15, read buffer=w12)
            call "Clear (Instr).gvi"(session in=w14, error in=w15) -> (session out=w2, error out=w13)
          }
        }
        Concatenate Strings(s1, w12) -> w16
        Search And Replace String(error in (no error)=w13, input string=w12, search string="M") -> (error out=w1, number of replacements=w17)
        Is Not Equal To 0(x=w17) -> w18
        Is Greater(x=i1, y=200) -> w19
        Logical Or(w18, $Abort, w19) -> w20
        next s1 = w16
        stop if w20
      }
      Number To Decimal String(number=i1) -> (decimal integer string=w21)
      Concatenate Strings(s1, " cycles ", w21) -> w3
      $"XZ Stage Arduino Log While" <- w3
    }
  }
  $"XZ Carriage Arduino open Visa Session Out" <- w2
  $"Error Out" <- w1
  $"XZ Stage Arduino Log Out" <- w3
