vi "Rotary Stage Home Sequence.gvi"   [LabVIEW NXG 5.0.0]
inputs:
  "Error In": error
  "Rotary Open Visa Session In": "VISA Instr"
  "Rotary Arduino Log In": string
outputs:
  "Error Out": error
  "Rotary Arduino Open Visa Session Out": "VISA Instr"
  "Rotary Arduino Log Out": string
  "XZ Stage Homed?": bool
panel controls:
  "Abort Homing": bool
panel indicators:
  "Rotary Arduino Log While": string
diagram:
  # This SubVI tries to home the arduino using the XZ Stage Homing Low level SubVI. If it the homing fails
  # it prompts the user to reconnect everything and if it keeps failing it gives the user the oportunity to continue
  # without homing for testing purposes only.
  case ($"Error In") {
    frame Error, Default {
      w1 = $"Error In"
      w2 = $"Rotary Open Visa Session In"
      w3 = $"Rotary Arduino Log In"
      w4 = default
    }
    frame No Error {
      s1 = $"Error In"  # shift register
      s2 = $"Rotary Open Visa Session In"  # shift register
      s3 = $"Rotary Arduino Log In"  # shift register
      while (iteration -> i1) {
        call "Rotary Stage Homing Low Level.gvi"(Rotary Arduino open Visa session In=s2, Rotary Arduino Log In=s3, Error In=s1) -> (Homed?=w5, Rotary Arduino open Visa Session Out=w6, Rotary Arduino Log Out=w7, Error Out=w8)
        $"Rotary Arduino Log While" <- w7
        Logical And(w5, not $"Abort Homing") -> w4
        Wait Until Next Multiple(multiple to wait=50)
        Is Greater Or Equal(x=i1, y=1) -> w9
        case (w5) {
          frame True {
            w10 = TRUE
            w11 = w8
          }
          frame False {
            case (w9) {
              frame True {
                w12 = """The arduino Could not home
propperly, please make sure 
that the motors can move freely
and that the motor power supply 
is correctly connected"""
                Two Button Dialog(F button name ("Cancel")="Okay I will connect everything", T button name ("OK")="Continue without homing\n(TESTING ONLY!!!)", message=w12) -> (T Button?=w10)
              }
              frame False {
                w13 = """The arduino Could not home
propperly, please make sure 
that the motors can move freely
and that the motor power supply 
is correctly connected"""
                One Button Dialog(button name ("OK")="Okay I will make sure\neverything is allright", message=w13)
                w10 = default
              }
            }
            w11 = w8
          }
        }
        Logical Or(w10, $"Abort Homing") -> w14
        next s1 = w11
        next s2 = w6
        next s3 = w7
        stop if w14
      }
      w1 = s1
      w2 = s2
      w3 = s3
    }
  }
  $"Rotary Arduino Open Visa Session Out" <- w2
  $"Rotary Arduino Log Out" <- w3
  $"Error Out" <- w1
  $"XZ Stage Homed?" <- w4
