vi "Rotary Stage Initialize.gvi"   [LabVIEW NXG 5.0.0]
inputs:
  "Error In": error
  "Rotary Arduino Adress In": "VISA Instr"
outputs:
  "Error Out": error
  "Rotary Arduino Visa Session Out": "VISA Instr"
  "Rotary Arduino Log": string
uses:
  NI::VISA::Open (Instr).gvi
  NI::VISA::Read (Instr, String).gvi
diagram:
  # This SubVI initializes the Rotary Stage Arduino basically reading on the serial so that
  # the welcome message can be flushed.
  case ($"Error In") {
    frame Error, Default {
      w1 = $"Error In"
      w2 = default
      w3 = $"Rotary Arduino Adress In"
    }
    frame No Error {
      call "Open (Instr).gvi"(resource name=$"Rotary Arduino Adress In", error in=$"Error In", access mode="VISA Defaults"(0), open timeout=1000) -> (session out=w4, error out=w5)
      s1 = ""  # shift register
      while (iteration -> i1) {
        Property Node(instance in=w4, error in=w5) -> ("ASRL Bytes at Port"=w6, error out=w7, instance out=w8)
        call "Read (Instr, String).gvi"(session in=w8, error in=w7, byte count=w6) -> (session out=w3, error out=w1, read buffer=w9)
        Concatenate Strings(s1, w9) -> w10
        Wait Until Next Multiple(multiple to wait=100)
        Is Greater(x=i1, y=20) -> w11
        next s1 = w10
        stop if w11
      }
      w2 = s1
    }
  }
  $"Rotary Arduino Visa Session Out" <- w3
  $"Error Out" <- w1
  $"Rotary Arduino Log" <- w2
