vi "Rotary Stage Move To Location.gvi"   [LabVIEW NXG 5.0.0]
inputs:
  "Error In": error
  "Rotary Stage Arduino open Visa session In": "VISA Instr"
  "Rotary Stage Arduino Log In": string
  "Input Command": string = "G1 X100 Z100"
outputs:
  "Error Out": error
  "Rotary Stage Arduino open Visa Session Out": "VISA Instr"
  "Rotary Stage Arduino Log Out": string
uses:
  NI::VISA::Clear (Instr).gvi
  NI::VISA::Write (Instr, String).gvi
diagram:
  # This SubVI Sends a command to the XZ stage arduino to move it to a specified location and It waits for the arduino to respond.
  # If the arduino responds with Moved the operation is successful and it continues on without errors. If the arduino responds with
  #  coordinate out of range it prompts the user accordingly. If the arduino just does not respond the reading stops and the software
  #  attempts to write the command again up to 5 times. If the movement has failed after 5 times the software prompts the user
  #  recommending to connect everything
  # correctly and restarting the software.
  case ($"Error In") {
    frame Error, Default {
      w1 = $"Error In"
      w2 = $"Rotary Stage Arduino open Visa session In"
      w3 = $"Rotary Stage Arduino Log In"
    }
    frame No Error {
      Is Empty String Or Path(string/path=$"Input Command") -> w4
      case (w4) {
        frame True {
          w5 = "Tried to move the Rotary Stage but\nthe movement command was empty!"
          One Button Dialog(button name ("OK")="Oh sorry I will\nsee what went wrong", message=w5)
          w1 = $"Error In"
          w2 = $"Rotary Stage Arduino open Visa session In"
          w3 = $"Rotary Stage Arduino Log In"
        }
        frame False {
          Concatenate Strings($"Input Command", "\r\n") -> w6
          s1 = $"Rotary Stage Arduino open Visa session In"  # shift register
          s2 = $"Error In"  # shift register
          s3 = $"Rotary Stage Arduino Log In"  # shift register
          while (iteration -> i1) {
            call "Clear (Instr).gvi"(session in=s1, error in=s2) -> (session out=w7, error out=w8)
            call "Write (Instr, String).gvi"(session in=w7, error in=w8, write buffer=w6) -> (session out=w9, error out=w10)
            call "Wait.gvi"(Error In=w10, milliseconds to wait=100) -> (Error Out=w11)
            s4 = w9  # shift register
            s5 = w11  # shift register
            s6 = s3  # shift register
            while (iteration -> i2) {
              call "Rotary Stage Read Serial.gvi"(Rotary Stage Arduino open Visa session In=s4, Error In=s5) -> (Rotary Stage Arduino open Visa session Out=w14, Read Output=w15, Error Out=w16)
              call "Rotary Stage Moved Check.gvi"(Serial Read=w15, XZ Stage Log In=s6, Error In=w16, Loop Iteration=i2) -> (Stop Loop?=w17, Moved?=w18, Coordinate Out Of Range?=w19, XZ Stage Log Out=w20, Error Out=w21)
              Wait Until Next Multiple(multiple to wait=100)
              append w18 to w12
              append w19 to w13
              next s4 = w14
              next s5 = w21
              next s6 = w20
              stop if w17
            }
            call "Rotary Stage Movement Failed Prompt.gvi"(Coordinate Out Of Range?=w13, Moved?=w12, Error In=s5, Loop Iterations=i1) -> (Stop Loop?=w22, Error Out=w23)
            next s1 = s4
            next s2 = w23
            next s3 = s6
            stop if w22
          }
          w1 = s2
          w2 = s1
          w3 = s3
        }
      }
    }
  }
  $"Rotary Stage Arduino open Visa Session Out" <- w2
  $"Error Out" <- w1
  $"Rotary Stage Arduino Log Out" <- w3
