vi "Rotary Stage Moved Check.gvi"   [LabVIEW NXG 5.0.0]
inputs:
  "Error In": error
  "Loop Iteration": i32
  "Serial Read": string
  "Global Abort?": bool
  "XZ Stage Log In": string
outputs:
  "Error Out": error
  "XZ Stage Log Out": string
  "Coordinate Out Of Range?": bool
  "Moved?": bool
  "Stop Loop?": bool
diagram:
  # This SubVI Takes the Serial Read and checks if the Rotary Stage has already
  # moved or if the coordinate is out of range. and outputs the corresponding
  # boolean combination
  case ($"Error In") {
    frame Error, Default {
      w1 = default
      w2 = default
      w3 = $"Error In"
      w4 = default
      w5 = $"XZ Stage Log In"
    }
    frame No Error {
      Concatenate Strings($"XZ Stage Log In", $"Serial Read") -> w5
      Search And Replace String(error in (no error)=$"Error In", input string=$"Serial Read", search string="Coordinate") -> (error out=w6, number of replacements=w7)
      Search And Replace String(error in (no error)=w6, input string=$"Serial Read", search string="Moved") -> (error out=w3, number of replacements=w8)
      Is Greater(x=$"Loop Iteration", y=60) -> w9
      Is Not Equal To 0(x=w7) -> w1
      Is Not Equal To 0(x=w8) -> w2
      Logical Or(w2, w9, $"Global Abort?", w3, w1) -> w4
    }
  }
  $"XZ Stage Log Out" <- w5
  $"Coordinate Out Of Range?" <- w1
  $"Moved?" <- w2
  $"Error Out" <- w3
  $"Stop Loop?" <- w4
