vi "Rotary Stage Movement Failed Prompt.gvi"   [LabVIEW NXG 5.0.0]
inputs:
  "Error In": error
  "Loop Iterations": i32
  "Coordinate Out Of Range?": bool[]
  "Moved?": bool[]
outputs:
  "Error Out": error
  "Stop Loop?": bool
diagram:
  # This subVI Prompts the user in case the Serial Read outputs
  # a movement error.
  case ($"Error In") {
    frame Error, Default {
      w1 = $"Error In"
      w2 = TRUE
    }
    frame No Error {
      Or Array Elements(Boolean array=$"Coordinate Out Of Range?") -> (logical OR=w3)
      case (w3) {
        frame False, Default { }
        frame True {
          One Button Dialog(button name ("OK")="Oh Sorry,\nit wasn't my intention", message="The coordinate you requested is \nout of range.")
        }
      }
      Or Array Elements(Boolean array=$"Moved?") -> (logical OR=w4)
      Is Greater(x=$"Loop Iterations", y=5) -> w5
      Logical And(w5, not w4) -> w6
      case (w6) {
        frame False, Default { }
        frame True {
          w7 = """Rotary Stage Movement Might 
have Failed Please make sure the 
power cord is connected as 
well as the USB Cable. 
(You might have to restart the 
software)"""
          One Button Dialog(button name ("OK")="Okay I will Check", message=w7)
        }
      }
      Logical Or(w5, w4) -> w2
      w1 = $"Error In"
    }
  }
  $"Error Out" <- w1
  $"Stop Loop?" <- w2
