vi "Rotary Stage Read Serial.gvi"   [LabVIEW NXG 5.0.0]
inputs:
  "Error In": error
  "Rotary Stage Arduino open Visa session In": "VISA Instr"
outputs:
  "Error Out": error
  "Rotary Stage Arduino open Visa session Out": "VISA Instr"
  "Read Output": string
uses:
  NI::VISA::Read (Instr, String).gvi
  NI::VISA::Clear (Instr).gvi
diagram:
  # This SubVI Reads the serial Input of the Rotary Stage and clears the buffer every now
  # and then to prevent visa clogging. It outputs the readings in the form of a string.
  case ($"Error In") {
    frame Error, Default {
      w1 = $"Error In"
      w2 = $"Rotary Stage Arduino open Visa session In"
      w3 = ""
    }
    frame No Error {
      Property Node(instance in=$"Rotary Stage Arduino open Visa session In", error in=$"Error In") -> ("ASRL Bytes at Port"=w4, error out=w5, instance out=w6)
      Is Not Equal To 0(x=w4) -> w7
      Is Greater(x=w4, y=300) -> w8
      case (w7) {
        frame False, Default {
          w3 = ""
          w2 = w6
          w1 = w5
        }
        frame True {
          call "Read (Instr, String).gvi"(session in=w6, error in=w5, byte count=w4) -> (session out=w9, error out=w10, read buffer=w3)
          case (w8) {
            frame False, Default {
              w2 = w9
              w1 = w10
            }
            frame True {
              call "Clear (Instr).gvi"(session in=w9, error in=w10) -> (session out=w2, error out=w1)
            }
          }
        }
      }
    }
  }
  $"Rotary Stage Arduino open Visa session Out" <- w2
  $"Error Out" <- w1
  $"Read Output" <- w3
