vi "Rotary Disable Steppers.gvi"   [LabVIEW NXG 5.0.0]
inputs:
  "Error In": error
  "Instrument Info": "Instrument Info.gtype"
outputs:
  "Error Out": error
  "instrument info out": "Instrument Info.gtype"
types:
  "Instrument Info.gtype" = cluster{"PortCom_Sample": "VISA Instr", "Rotary Stage Address": "VISA Instr", "Rotary Homed?": bool, "Wrapper": f64, "Rotary Stage Log": string}
uses:
  NI::VISA::Write (Instr, String).gvi
diagram:
  # This SubVI Disables the stepper Motor so that the stage can be moved by hand
  case ($"Error In") {
    frame Error, Default {
      w1 = $"Error In"
      w2 = $"Instrument Info"
    }
    frame No Error {
      Property Node(instance in=$"Instrument Info") -> ("Rotary Stage Address"=w3, instance out=w4)
      Concatenate Strings("M18", "\r\n") -> w5
      call "Write (Instr, String).gvi"(session in=w3, error in=$"Error In", write buffer=w5) -> (session out=w6, error out=w7)
      Property Node(instance in=w4, "Rotary Stage Address"=w6) -> (instance out=w2)
      call "Wait.gvi"(Error In=w7, milliseconds to wait=100) -> (Error Out=w1)
    }
  }
  $"instrument info out" <- w2
  $"Error Out" <- w1
