vi "Rotary Shutter.gvi"   [LabVIEW NXG 5.0.0]
inputs:
  "Error In": error
  "Instrument Info": "Instrument Info.gtype"
  "Snapshot Exposure Time (ms)": i32
  "Shutter Operations": "Shutter Operations.gtype" = "Snapshot"
outputs:
  "Error Out": error
  "instrument info out": "Instrument Info.gtype"
types:
  "Instrument Info.gtype" = cluster{"PortCom_Sample": "VISA Instr", "Rotary Stage Address": "VISA Instr", "Rotary Homed?": bool, "Wrapper": f64, "Rotary Stage Log": string}
  "Shutter Operations.gtype" = enum{"Snapshot", "Open Shutter", "Close Shutter"}
uses:
  NI::VISA::Write (Instr, String).gvi
diagram:
  # This SubVI Controls The Shutter in vasious ways
  case ($"Error In") {
    frame Error, Default {
      w1 = $"Error In"
      w2 = $"Instrument Info"
    }
    frame No Error {
      Property Node(instance in=$"Instrument Info") -> ("Rotary Stage Address"=w3, instance out=w4)
      case ($"Shutter Operations") {
        frame "Snapshot", Default {
          Number To Fractional String(number=$"Snapshot Exposure Time (ms)", precision (6)=0, use system decimal point (T)=FALSE) -> (F-format string=w6)
          Concatenate Strings("M212 P", w6) -> w5
        }
        frame "Open Shutter" {
          w5 = "M213"
        }
        frame "Close Shutter" {
          w5 = "M214"
        }
      }
      Concatenate Strings(w5, "\r\n") -> w7
      call "Write (Instr, String).gvi"(session in=w3, error in=$"Error In", write buffer=w7) -> (session out=w8, error out=w9)
      Property Node(instance in=w4, "Rotary Stage Address"=w8) -> (instance out=w2)
      call "Wait.gvi"(Error In=w9, milliseconds to wait=100) -> (Error Out=w1)
    }
  }
  $"instrument info out" <- w2
  $"Error Out" <- w1
