vi "Rotary Stage Close Coms.gvi"   [LabVIEW NXG 5.0.0]
inputs:
  "Error In": error
  "Instrument Info In": "Instrument Info.gtype"
outputs:
  "Error Out": error
  "Instrument Info Out": "Instrument Info.gtype"
types:
  "Instrument Info.gtype" = cluster{"PortCom_Sample": "VISA Instr", "Rotary Stage Address": "VISA Instr", "Rotary Homed?": bool, "Wrapper": f64, "Rotary Stage Log": string}
uses:
  NI::VISA::Close (Instr).gvi
diagram:
  # This SubVI Checks if the XZ Stage Adress is empty and if not it closes the comunications with the address
  case ($"Error In") {
    frame Error, Default {
      w1 = $"Error In"
      w2 = $"Instrument Info In"
    }
    frame No Error {
      Property Node(instance in=$"Instrument Info In") -> ("Rotary Stage Address"=w3, instance out=w2)
      Is Empty String Or Path(string/path=w3) -> w4
      case (w4) {
        frame False, Default {
          call "Close (Instr).gvi"(session in=w3, error in=$"Error In") -> (error out=w1)
        }
        frame True {
          w1 = $"Error In"
        }
      }
    }
  }
  $"Instrument Info Out" <- w2
  $"Error Out" <- w1
