vi "Rotary Stage Initialize And Home.gvi"   [LabVIEW NXG 5.0.0]
inputs:
  "Comunications Ports In": "Instrument Info.gtype"
  "Error In": error
outputs:
  "Comunications Ports Out": "Instrument Info.gtype"
  "Error Out": error
types:
  "Instrument Info.gtype" = cluster{"PortCom_Sample": "VISA Instr", "Rotary Stage Address": "VISA Instr", "Rotary Homed?": bool, "Wrapper": f64, "Rotary Stage Log": string}
diagram:
  # This SubVI Initializes the XZ stage and homes it while appending the log onto the Instrument Coms Info Cluster
  # It also checks the debugging cluster to see if we want to use the Arduinos or not
  case ($"Error In") {
    frame Error, Default {
      w1 = $"Error In"
      w2 = $"Comunications Ports In"
    }
    frame No Error {
      Property Node(instance in=$"Comunications Ports In") -> ("Rotary Stage Address"=w3, instance out=w4)
      call "Rotary Stage Initialize.gvi"(Rotary Arduino Adress In=w3, Error In=$"Error In") -> (Rotary Arduino Visa Session Out=w5, Rotary Arduino Log=w6, Error Out=w7)
      call "Rotary Stage Home Sequence.gvi"(Rotary Open Visa Session In=w5, Rotary Arduino Log In=w6, Error In=w7) -> (Rotary Arduino Log Out=w8, XZ Stage Homed?=w9, Error Out=w1)
      Property Node(instance in=w4, "Rotary Stage Log"=w8, "Rotary Homed?"=w9) -> (instance out=w2)
    }
  }
  $"Comunications Ports Out" <- w2
  $"Error Out" <- w1
