vi "Rotary Stage Move to Position.gvi"   [LabVIEW NXG 5.0.0]
inputs:
  "Instrument Info In": "Instrument Info.gtype"
  "Error In": error
  "Rotary Move Cluster": "Rotary Move Cluster.gtype"
outputs:
  "Instrument Control Mega Cluster Out": "Instrument Info.gtype"
  "Error Out": error
types:
  "Instrument Info.gtype" = cluster{"PortCom_Sample": "VISA Instr", "Rotary Stage Address": "VISA Instr", "Rotary Homed?": bool, "Wrapper": f64, "Rotary Stage Log": string}
  "Rotary Move Cluster.gtype" = cluster{"Position Degrees": f64, "Feedrate": i32}
diagram:
  # This SubVI Moves to the specified position
  case ($"Error In") {
    frame Error, Default {
      w1 = $"Error In"
      w2 = $"Instrument Info In"
    }
    frame No Error {
      Property Node(instance in=$"Instrument Info In") -> ("Rotary Stage Address"=w3, "Rotary Stage Log"=w4, instance out=w5)
      call "Rotary Stage Coordinate to Gcode.gvi"(Rotary Move Cluster=$"Rotary Move Cluster", Error In=$"Error In") -> (Gcode Instruction=w6, Error Out=w7)
      call "Rotary Stage Move To Location.gvi"(Rotary Stage Arduino open Visa session In=w3, Rotary Stage Arduino Log In=w4, Error In=w7, Input Command=w6) -> (Rotary Stage Arduino Log Out=w8, Error Out=w1)
      Property Node(instance in=w5, "Rotary Stage Log"=w8) -> (instance out=w2)
    }
  }
  $"Instrument Control Mega Cluster Out" <- w2
  $"Error Out" <- w1
