vi "Rotary Test.gvi"   [LabVIEW NXG 5.0.0]
panel indicators:
  "Instrument Info Out": "Instrument Info.gtype"
types:
  "Instrument Info.gtype" = cluster{"PortCom_Sample": "VISA Instr", "Rotary Stage Address": "VISA Instr", "Rotary Homed?": bool, "Wrapper": f64, "Rotary Stage Log": string}
  "Rotary Move Cluster.gtype" = cluster{"Position Degrees": f64, "Feedrate": i32}
diagram:
  w1 = "Rotary Move Cluster.gtype" {"Position Degrees"=-90, "Feedrate"=100}
  w2 = "Instrument Info.gtype" {"PortCom_Sample"="", "Rotary Stage Address"="COM9", "Rotary Homed?"=FALSE, "Wrapper"=0, "Rotary Stage Log"=""}
  call "Rotary Stage Initialize And Home.gvi"(Comunications Ports In=w2) -> (Comunications Ports Out=w3, Error Out=w4)
  call "Rotary Stage Move to Position.gvi"(Instrument Info In=w3, Rotary Move Cluster=w1, Error In=w4) -> (Instrument Control Mega Cluster Out=w5, Error Out=w6)
  call "Rotary Disable Steppers.gvi"(Instrument Info=w5, Error In=w6) -> (instrument info out=w7, Error Out=w8)
  call "Rotary Shutter.gvi"(Instrument Info=w7, Error In=w8, Shutter Operations="Open Shutter") -> (instrument info out=w9, Error Out=w10)
  call "Rotary Shutter.gvi"(Instrument Info=w9, Error In=w10, Shutter Operations="Close Shutter") -> (instrument info out=w11, Error Out=w12)
  call "Rotary Shutter.gvi"(Instrument Info=w11, Snapshot Exposure Time (ms)=50, Error In=w12, Shutter Operations="Snapshot") -> (instrument info out=w13, Error Out=w14)
  call "Rotary Stage Close Coms.gvi"(Instrument Info In=w13, Error In=w14) -> (Instrument Info Out=w15)
  $"Instrument Info Out" <- w15
